# Dynamo graph DesignScript.dyn (Dynamo 2.13.1.3887)

# group: DesignScript
boolean = BoolSelector(false)
python_script = Python(IN[0]=boolean)  # CPython3
# ---------- python_script.python (3 lines) ----------
f = open(r"D:\CODE DYNAMO REVIT_PYTHON\10_DYNAMO REVIT\CODE-DYNAMO-REVIT\Study_1\DesignScript.py", "r")

OUT = f.read() 
# ----------------------------------------
python_script_from_string = PythonStringNode(script=python_script)  # CPython3; unwired: IN[0]
