# Dynamo graph DesignScriptDynamo.dyn (Dynamo 2.13.1.3887)

boolean = BoolSelector(false)
code_block = CodeBlock { [1,2,3,4,5,6,7,8,9,10,11,12]; }
byCoordinates = Point.ByCoordinates(x=code_block)
selectEvenPoint = Python(IN[0]=boolean, IN[1]=byCoordinates)  # IronPython2
# ---------- selectEvenPoint.python (8 lines) ----------
items =IN[1]

result = []
for num in range(0,len(items),1):
    if not num %2:
        result.append(items[num])

OUT =  result
# ----------------------------------------
boolean_2 = BoolSelector(false)
code_block_2 = CodeBlock { 2; }
byCoordinates_2 = Point.ByCoordinates(x=code_block, y=code_block_2)
selectOldPoint = Python(IN[0]=boolean_2, IN[1]=byCoordinates_2)  # IronPython2
# ---------- selectOldPoint.python (8 lines) ----------
items =IN[1]

result = []
for num in range(0,len(items),1):
    if num %2:
        result.append(items[num])

OUT =  result
# ----------------------------------------
byStartPointEndPoint = Line.ByStartPointEndPoint(startPoint=selectEvenPoint, endPoint=selectOldPoint)
list = Python(IN[0]=selectEvenPoint)  # "DropItem.List"; CPython3
# ---------- list.python (1 lines) ----------
OUT = IN[0][1:]
# ----------------------------------------
byStartPointEndPoint_2 = Line.ByStartPointEndPoint(startPoint=list, endPoint=selectOldPoint)

# group: DesignScript
boolean_3 = BoolSelector(false)
python_script = Python(IN[0]=boolean_3)  # CPython3
# ---------- python_script.python (3 lines) ----------
f = open(r"D:\CODE DYNAMO REVIT_PYTHON\10_DYNAMO REVIT\CODE-DYNAMO-REVIT\Study_1\DesignScript.py", "r")

OUT = f.read() 
# ----------------------------------------
python_script_from_string = PythonStringNode(script=python_script)  # CPython3; unwired: IN[0]
